# Dynamo graph Element_Info.dyn (Dynamo 3.3.0.6316)

select_model_element = DSModelElementSelection()  # 1 picked in the model
python_script = Python(IN[0]=select_model_element)  # CPython3
# ---------- python_script.python (150 lines) ----------
# Dynamo Python Script — outputs namespace, class, category, family, and all parameters of input element(s)

import clr
clr.AddReference("RevitNodes")
import Revit
clr.ImportExtensions(Revit.Elements)

clr.AddReference("RevitServices")
from RevitServices.Persistence import DocumentManager

clr.AddReference("RevitAPI")
from Autodesk.Revit.DB import FamilyInstance, StorageType, ElementId

doc = DocumentManager.Instance.CurrentDBDocument

# Returns "Autodesk.Revit.DB.Wall" — full namespace + class
# """'Autodesk.Revit.DB.FamilyInstance'"""
def get_full_namespace(api_element):
    t = type(api_element)
    return t.__module__ + "." + t.__name__

# Returns just the class name, e.g. "Wall"
# """'FamilyInstance'"""
def get_class_name(api_element):
    return type(api_element).__name__

# Returns the Revit category name, or "<no category>"
# """'Doors'"""
def get_category_name(api_element):
    cat = api_element.Category
    if cat is None:
        return "<no category>"
    return cat.Name

# Safely reads .Name on any element; some Revit classes have write-only Name
# """'Level 1'"""
def safe_name(elem):
    try:
        return elem.Name
    except:
        return "Id<" + str(elem.Id.IntegerValue) + ">"

# Returns family name; handles FamilyInstance and system families
# """'M_Single-Flush'"""
def get_family_name(api_element):
    if isinstance(api_element, FamilyInstance):
        return api_element.Symbol.Family.Name
    type_id = api_element.GetTypeId()
    if type_id and type_id.IntegerValue > 0:
        elem_type = doc.GetElement(type_id)
        if elem_type is not None:
            return elem_type.FamilyName or safe_name(elem_type)
    return "<no family>"

# Returns a readable string for one parameter's value, based on its storage type
# """'3000 mm'"""
def parameter_value_to_string(param):
    try:
        if not param.HasValue:
            return "<none>"
        
        storage = param.StorageType
        
        if storage == StorageType.String:
            return param.AsString() or ""
        
        if storage == StorageType.Integer:
            try:
                as_str = param.AsValueString()         # "Yes"/"No" for booleans, formatted ints
                if as_str:
                    return as_str
            except:
                pass
            return str(param.AsInteger())
        
        if storage == StorageType.Double:
            try:
                as_str = param.AsValueString()         # formatted with project units
                if as_str:
                    return as_str
            except:
                pass
            return str(param.AsDouble())
        
        if storage == StorageType.ElementId:
            eid = param.AsElementId()
            if eid is None or eid.IntegerValue < 0:    # InvalidElementId
                return "<none>"
            ref_elem = doc.GetElement(eid)
            if ref_elem is not None:
                return safe_name(ref_elem)             # uses try/except inside
            return "Id<" + str(eid.IntegerValue) + ">"
        
        return "<unknown storage>"
    except:
        return "<unreadable>"                          # last-resort guard

# Returns a list of (name, value, is_read_only) tuples in Properties-palette order
# """[('Mark', 'A-101', False), ('Comments', '', False), ...]"""
def collect_parameters(api_element):
    result = []
    for p in api_element.GetOrderedParameters():
        try:
            name = p.Definition.Name
        except:
            name = "<unreadable name>"
        value = parameter_value_to_string(p)
        try:
            read_only = p.IsReadOnly
        except:
            read_only = True
        result.append((name, value, read_only))
    return result

# Returns instance + type parameters as a dict with two labeled groups
# """{'instance': [...], 'type': [...]}"""
def get_all_parameters(api_element):
    instance_params = collect_parameters(api_element)
    
    type_params = []
    type_id = api_element.GetTypeId()
    if type_id and type_id.IntegerValue > 0:
        elem_type = doc.GetElement(type_id)
        if elem_type is not None:
            type_params = collect_parameters(elem_type)
    
    return {"instance": instance_params, "type": type_params}

# Bundles all info about one element into a labeled dict
# """{'namespace': '...', 'class': '...', 'category': '...', 'family': '...', 'parameters': {...}}"""
def describe_element(element):
    api_element = UnwrapElement(element)
    return {
        "namespace":  get_full_namespace(api_element),
        "class":      get_class_name(api_element),
        "category":   get_category_name(api_element),
        "family":     get_family_name(api_element),
        "parameters": get_all_parameters(api_element),
    }

# Handles either a single element or a list
# """[{...}, {...}]"""
def describe_input(input_data):
    if isinstance(input_data, list):
        return [describe_element(e) for e in input_data]
    return describe_element(input_data)

# --- main ---
input_element = IN[0]
OUT = describe_input(input_element)
# ----------------------------------------
watch = Watch(python_script)
